# Grasshopper definition rhino_input.gh (Grasshopper 1.0.7)

number_slider = Slider(1, range=0..10)
encodedfile = GetString(AtLeast=1, AtMost=1, TreeAccess=False)

# ---- group: just to test
path = FilePath("C:\Users\david\IAAC\MaCAD\datamgmt\repos\bimsc24-datamgmt-session06\src\assets\rhino_input.3dm")

# ----
Y = GetNumber(number_slider, AtLeast=1, AtMost=1, Maximum=1.797693135e+308, Minimum=-1.797693135e+308, TreeAccess=False)
Z = GetNumber(number_slider, AtLeast=1, AtMost=1, Maximum=1.797693135e+308, Minimum=-1.797693135e+308, TreeAccess=False)
X = GetNumber(number_slider, AtLeast=1, AtMost=1, Maximum=1.797693135e+308, Minimum=-1.797693135e+308, TreeAccess=False)
# no points allowed in 3dm!
python = GhPythonScript(data=encodedfile, FP=path)  # -> out, geom, layerIndex, layers, layerColor
# ---------- python: Python ----------
import System
import Rhino

#load Rhino file from string, or from local path
try:
    b64 = System.Convert.FromBase64String(data)
    _dmfile = Rhino.FileIO.File3dm.FromByteArray(b64)
except:
    _dmfile = Rhino.FileIO.File3dm.Read(FP)
    print _dmfile



objtable = _dmfile.Objects
geom = []
geomLayerIndexList = []

#get objects from document
for obj in objtable:
    
    if not isinstance(obj.Geometry,Rhino.Geometry.InstanceReferenceGeometry):
        #get user strings from document and assign to geometry
        for k in obj.Attributes.GetUserStrings().AllKeys:
            value =  obj.Attributes.GetUserString(k)
            obj.Geometry.SetUserString(k, value)
       
        geom.append(obj.Geometry)
        geomLayerIndexList.append(obj.Attributes.LayerIndex)
        

geom_= geom
layerIndex_ = geomLayerIndexList

#get layer information
layers = []
layerColor = []
for l in _dmfile.Layers:
    layerColor.append(l.Color)
    layers.append(l)
    
    
layers_ = layers
layerColor_  = layerColor
# ---------- end python ----------
list = ValueList({"Mesh": 0, "Brep": 1, "SubD": 2, "Curve": 3}, selected="Brep")
type = GetString(list, AtLeast=1, AtMost=1, TreeAccess=False)

# ---- group: filter by type
python_2 = GhPythonScript(type=type, geo=python.geom)  # -> out, filter_geo, unfiltered; inputs type: Int32, geo: list of GeometryBase
# ---------- python_2: Python ----------
import Rhino.Geometry as rg
import rhinoscriptsyntax as rs

filter_geo= []
unfiltered = []
geo_types = ["Mesh", "Brep", "SubD", "NurbsCurve" ]

for g in geo:
    
    g = rs.coercegeometry(g)
    
    if type(g).__name__ == geo_types[_type]:

        filter_geo.append(g)
    else:
        unfiltered.append(g)
        
filter_geo_ = filter_geo
unfiltered_ = unfiltered
# ---------- end python_2 ----------

# ----
python_3 = GhPythonScript(geoms=python.geom, user_key="name")  # -> out, user_values; inputs geoms: list of GeometryBase
# ---------- python_3: Python ----------
user_values = []

for g in geoms:
    user_values.append( g.GetUserString(user_key))


user_values_ = user_values
# ---------- end python_3 ----------
panel = Panel(python.geom)
scale_nu = ScaleNU(Geometry=python_2.filter_geo, Plane=PlaneXY(0, 0, 0), ScaleX=X, ScaleY=Y, ScaleZ=Z)  # -> Geometry, Transform
panel_2 = Panel(python_3.user_values)

# ---- group: convert breps to meshes
python_4 = GhPythonScript(geo=scale_nu.Geometry)  # -> out, converted; inputs geo: list of GeometryBase
# ---------- python_4: Python ----------
import Rhino.Geometry as rg

def convertBrepToMesh(brep):

    mp = rg.MeshingParameters.Coarse
    g = rg.Mesh.CreateFromBrep(brep, mp)
    newm = rg.Mesh()
    for meshes in g:
        newm.Append(meshes)
    return newm
    
converted = []

for g in geo:
    if type(g).__name__ == "Brep":
        try:
            mesh =convertBrepToMesh(g)
            
            converted.append(mesh)
        except:
            continue
    else:
        converted.append(g)

converted_ = converted
# ---------- end python_4 ----------

# ----
context_bake = ContextBake(ScaledGeo=python_4.converted)
